# Grasshopper definition tetratrum.gh (Grasshopper 1.0.7)

# ----
# play with these parameters!
o_to_vertex = Slider(30, range=30..80)
cir_r = Slider(15, range=5..30)
thickness = Slider(4.053, range=2..5)

polygon = Polygon(Plane=PlaneXY(0, 0, 0), Radius=o_to_vertex, Segments=3, FilletRadius=0)  # -> Polygon, Length
circle = Circle(Plane=PlaneXY(0, 0, 0), Radius=cir_r)
deconstruct_brep = DeconstructBrep(Brep=circle)  # -> Faces, Edges, Vertices
division = Division(A=thickness, B=2)
deconstruct_brep_2 = DeconstructBrep(Brep=polygon.Polygon)  # -> Faces, Edges, Vertices
curve_middle = CurveMiddle(Curve=deconstruct_brep_2.Edges)
mirror = Mirror(Geometry=deconstruct_brep_2.Faces, Plane=PlaneYZ(0, 0, 0))  # -> Geometry, Transform
sub_list = SubList(List=curve_middle, Domain=Domain(1, 1), Wrap=True)  # -> List, Index
point = Point(Point(0, 0, 0))
rectangle = Rectangle(Plane=sub_list.List, XSize=division, YSize=cir_r, Radius=0)  # -> Rectangle, Length
distance = Distance(PointA=point, PointB=sub_list.List)
rectangle_2 = Rectangle(Plane=deconstruct_brep.Vertices, XSize=division, YSize=cir_r, Radius=0)  # -> Rectangle, Length
number = Number(-2)
multiplication = Multiplication(A=distance, B=number)
rotate = Rotate(Geometry=rectangle_2.Rectangle, Angle=4.71238898, Plane=deconstruct_brep.Vertices)  # -> Geometry, Transform
rotate_2 = Rotate(Geometry=rectangle.Rectangle, Angle=4.71238898, Plane=sub_list.List)  # -> Geometry, Transform
xz_plane = XZPlane(Origin=deconstruct_brep.Vertices)
unit_x = UnitX(Factor=multiplication)
number_2 = Number(-0.5)
number_3 = Number(0.5)
mirror_2 = Mirror(Geometry=rotate.Geometry, Plane=xz_plane)  # -> Geometry, Transform
multiplication_2 = Multiplication(A=cir_r, B=number_2)
multiplication_3 = Multiplication(A=division, B=number_3)
move = Move(Geometry=mirror.Geometry, Motion=unit_x)  # -> Geometry, Transform
deconstruct_brep_3 = DeconstructBrep(Brep=move.Geometry)  # -> Faces, Edges, Vertices
unit_x_2 = UnitX(Factor=multiplication_2)
unit_y = UnitY(Factor=multiplication_3)
merge = Merge(Data1=rotate.Geometry, Data2=mirror_2.Geometry)
curve_middle_2 = CurveMiddle(Curve=deconstruct_brep_3.Edges)

number_4 = Number(-1)
multiplication_4 = Multiplication(A=o_to_vertex, B=number_4)
multiplication_5 = Multiplication(A=multiplication_4, B=0.75)
unit_x_3 = UnitX(Factor=multiplication_5)

move_2 = Move(Geometry=rotate_2.Geometry, Motion=unit_y)  # -> Geometry, Transform
sub_list_2 = SubList(List=curve_middle_2, Domain=Domain(2, 3), Wrap=True)  # -> List, Index
move_3 = Move(Geometry=merge, Motion=unit_x_2)  # -> Geometry, Transform
move_4 = Move(Geometry=move_2.Geometry, Motion=unit_x_2)  # -> Geometry, Transform
split_list = SplitList(List=sub_list_2.List, Index=1)  # -> ListA, ListB
line = Line(StartPoint=split_list.ListA, EndPoint=split_list.ListB)
surface_split = SurfaceSplit(Surface=move.Geometry, Curves=line)
move_5 = Move(Geometry=move_4.Geometry, Motion=unit_x_3)  # -> Geometry, Transform
split_list_2 = SplitList(List=surface_split, Index=1)  # -> ListA, ListB
polar_array = PolarArray(Geometry=move_3.Geometry, Plane=PlaneXY(0, 0, 0), Count=2, Angle=6.283185307)  # -> flatten(Geometry), Transform
polar_array_2 = PolarArray(Geometry=split_list_2.ListA, Plane=PlaneXY(0, 0, 0), Count=3, Angle=6.283185307)  # -> Geometry, Transform
polar_array_3 = PolarArray(Geometry=move_5.Geometry, Plane=PlaneXY(0, 0, 0), Count=3, Angle=6.283185307)  # -> Geometry, Transform
region_union = RegionUnion(Curves=polar_array.Geometry)
trim_with_regions = TrimWithRegions(Curve=polar_array_3.Geometry, Regions=polar_array_2.Geometry)  # -> Inside, Outside
trim_with_regions_2 = TrimWithRegions(Curve=polar_array_2.Geometry, Regions=polar_array_3.Geometry)  # -> Inside, Outside
trim_with_regions_3 = TrimWithRegions(Curve=circle, Regions=region_union)  # -> Inside, Outside
trim_with_regions_4 = TrimWithRegions(Curve=region_union, Regions=circle)  # -> Inside, Outside
merge_2 = Merge(Data1=trim_with_regions_2.Outside, Data2=trim_with_regions.Inside)
merge_3 = Merge(Data1=trim_with_regions_3.Outside, Data2=trim_with_regions_4.Inside)  # -> flatten(Result)
join_curves = JoinCurves(Curves=merge_2, Preserve=False)
boundary_surfaces = BoundarySurfaces(Edges=join_curves)  # -> flatten(Surfaces)
insert_items = InsertItems(List=boundary_surfaces, Item=deconstruct_brep_2.Faces, Indices=0, Wrap=True)
brep_join = BrepJoin(Breps=insert_items)  # -> Breps, Closed
merge_faces = MergeFaces(Brep=brep_join.Breps)  # -> Breps, Before, After
deconstruct_brep_4 = DeconstructBrep(Brep=merge_faces.Breps)  # -> Faces, Edges, Vertices
unit_x_4 = UnitX(Factor=o_to_vertex)
join_curves_2 = JoinCurves(Curves=merge_3, Preserve=False)
curve = Curve(deconstruct_brep_4.Edges)
number_slider = Slider(5, range=0..10)
multiplication_6 = Multiplication(A=unit_x_4, B=2.25)
curve_2 = Curve(deconstruct_brep_2.Edges)
unit_x_5 = UnitX(Factor=o_to_vertex)
join_curves_3 = JoinCurves(Curves=curve_2, Preserve=False)
multiplication_7 = Multiplication(A=unit_x_5, B=2.25)

# ----
# score these!
linear_array = LinearArray(Geometry=[curve, join_curves_2], Direction=multiplication_6, Count=number_slider)  # -> Geometry, Transform

# ----
# cut these!
linear_array_2 = LinearArray(Geometry=join_curves_3, Direction=multiplication_7, Count=number_slider)  # -> Geometry, Transform
