# Grasshopper definition voronoi_tetra.gh (Grasshopper 1.0.7)
# plug-ins: Kangaroo2 Components

sphere = Sphere(
    Base=Plane(origin=(0, 7.332348419, 5.184753289), x=(0, 0.9999873065, -0.00503852676), y=(-1, 0, 0)),
    Radius=Slider(8, range=0..100))
solid_difference = SolidDifference(BrepsA=<geometry referenced from the Rhino model>, BrepsB=sphere)
populate_3d = Populate3D(Region=solid_difference, Count=Slider(8, range=0..100), Seed=Slider(4, range=0..100))
voronoi_3d = Voronoi3D(Points=populate_3d, Box=solid_difference)  # -> Cells, Boundary
solid_intersection = SolidIntersection(BrepsA=voronoi_3d.Cells, BrepsB=solid_difference)
number_slider = Slider(2.2, range=0..10)
deconstruct_brep = DeconstructBrep(Brep=solid_difference)  # -> Faces, Edges, flatten(Vertices)
split_list = SplitList(List=deconstruct_brep.Edges, Index=Slider(22, range=0..100))  # -> ListA, ListB
multipipe = MultiPipe(
    Curves=split_list.ListA,
    NodeSize=Slider(0.8, range=0..10),
    EndOffset=number_slider,
    StrutSize=1,
    Segment=0,
    KinkAngle=number_slider,
    CubeFit=0,
    Caps=0)
