# Grasshopper definition 1013_3bodyproblem.gh (Grasshopper 1.0.7)
# plug-ins: Firefly.Core

number_slider = Slider(3, range=0..4)
# initialize
toggle = BooleanToggle(True)
open_port = OpenClosePort(OpenClosePort=toggle, PortNumber=number_slider, BaudRate=115200)
panel = Panel(open_port)

# ----
# uno!
trigger = Trigger(Interval=20, TimerInterval=20, Target=[uno_read, rec])
uno_read = UnoRead(StartReadingValues=toggle, PortNumber=number_slider)  # -> AnalogPin0, AnalogPin1, AnalogPin2, AnalogPin3, AnalogPin4, AnalogPin5, DigitalPin2, DigitalPin4, DigitalPin7, StatusMessage; disabled
panel_2 = Panel(uno_read.AnalogPin0)

int = Integer(6)
rec = DataRecorder(int, DataLimit=-10, RecordData=True)  # disabled
# speed counter
ma = MassAddition(Input=rec)  # -> Result, PartialResults
panel_3 = Panel(ma.Result)

dist_factor = Integer(1)
division = Division(A=panel_2, B=dist_factor)
Z = UnitZ(Factor=1)

# ----
# 2nd body
pt = ConstructPoint(XCoordinate=panel_2, YCoordinate=panel_2, ZCoordinate=division)
rot3d = Rotate3D(Geometry=pt, Angle=degrees(panel_3), Center=Point(0, 0, 0), Axis=Z)  # -> Geometry, Transform
sph = Sphere(Base=rot3d.Geometry, Radius=Slider(156, range=0..200))

# ----
# 3rd body relative to 2nd body rotation
number_slider_2 = Slider(35.583, range=0..120)
division_2 = Division(A=panel_2, B=number_slider_2)

vec2pt = Vector2Pt(PointA=Point(0, 0, 0), PointB=rot3d.Geometry, Unitize=False)  # -> Vector, Length

vrot = Rotate(Vector=vec2pt.Vector, Axis=Z, Angle=division_2)

# ----
# 3rd body
move = Move(Geometry=rot3d.Geometry, Motion=vrot)  # -> Geometry, Transform
sph_2 = Sphere(Base=move.Geometry, Radius=Slider(101.273, range=0..200))
