# Grasshopper definition 1020_hanger.gh (Grasshopper 1.0.7)
# plug-ins: Firefly.Core

number_slider = Slider(3, range=0..4)
# initialize
toggle = BooleanToggle(True)
open_port = OpenClosePort(OpenClosePort=toggle, PortNumber=number_slider, BaudRate=115200)
panel = Panel(open_port)

# ----
# uno!
trigger = Trigger(Interval=20, TimerInterval=20, Target=uno_read)
uno_read = UnoRead(StartReadingValues=toggle, PortNumber=number_slider)  # -> AnalogPin0, AnalogPin1, AnalogPin2, AnalogPin3, AnalogPin4, AnalogPin5, DigitalPin2, DigitalPin4, DigitalPin7, StatusMessage; disabled
panel_2 = Panel(uno_read.AnalogPin0)

# ----
# lowest reading
# highest reading-lowest reading
num = Number(430)
pt = Point(Point(-5.826242625, -15.97704793, 28))
pt_2 = Point(Point(1050.745762, 593.9865331, -54))
slider_pin = Geometry(<brep referenced from the Rhino model>)
subtraction = Subtraction(A=panel_2, B=num)
vec2pt = Vector2Pt(PointA=pt, PointB=pt_2, Unitize=False)  # -> Vector, Length
num_2 = Number(160)
division = Division(A=subtraction, B=num_2)
multiplication = Multiplication(A=vec2pt.Vector, B=division)
move = Move(Geometry=slider_pin, Motion=multiplication)  # -> Geometry, Transform
num_3 = Number(-0.51)
num_4 = Number(950)
multiplication_2 = Multiplication(A=division, B=num_3)
multiplication_3 = Multiplication(A=division, B=num_4)
addition = Addition(A=multiplication_2, B=num_3)
rotate = Rotate(Geometry=move.Geometry, Angle=addition, Plane=PlaneXY(0, 0, 0))  # -> Geometry, Transform
Y = UnitY(Factor=multiplication_3)
move_2 = Move(Geometry=rotate.Geometry, Motion=Y)  # -> Geometry, Transform
